# Grasshopper definition Noise simulation_boxes.gh (Grasshopper 1.0.7)
# plug-ins: PachydermGH, PTComponentLibrary

# ---- group: 1. Generate Elements / Field contour
crv = Curve(<curve referenced from the Rhino model>)

# ---- group: 1. Generate Elements / Elements height
number_slider = Slider(1.8, range=0..100)

# ---- group: 1. Generate Elements / Elements number
number_slider_2 = Slider(6, range=0..100)
number_slider_3 = Slider(6, range=0..100)

# ---- group: 1. Generate Elements
# Noise Simulation
# Download https://www.food4rhino.com/en/app/pachyderm-acoustical-simulation
# The code below is divided to 3 main components.
# The first is the elements generator, which can be replaced with the park model or part of it.
# The second part of the code (2a)is the noise simulation calculation.
# Part 2b is for visualizing the noise propagation.
# The third part is the analysis of the "before and after" adding the noise mitigation elements.
# Feel free to change the model in Rhino and examine the outcome of the noise simulation accordingly.
boundary = BoundarySurfaces(Edges=crv)
srf = Surface(boundary)
Z = UnitZ(Factor=number_slider)
move = Move(Geometry=srf, Motion=Z)  # -> Geometry, Transform
ptsrfdomnum = SurfaceDomainNumber(Surface=srf, UNumber=number_slider_2, VNumber=number_slider_3)
ptsrfdomnum_2 = SurfaceDomainNumber(Surface=move.Geometry, UNumber=number_slider_2, VNumber=number_slider_3)

# ---- group: 1. Generate Elements / 2. Define paths / Magnitude
number_slider_4 = Slider(-1.5, range=-3..3)

# ---- group: 1. Generate Elements / 2. Define paths / Paths
crv_2 = Curve(<curve referenced from the Rhino model>)

# ---- group: 1. Generate Elements / 2. Define paths
ptcrvatts = CurveAttraction(Grid=ptsrfdomnum, CrvAtts=crv_2, Magnitude=number_slider_4)  # -> Grid, Weights
ptcrvatts_2 = CurveAttraction(Grid=ptsrfdomnum_2, CrvAtts=crv_2, Magnitude=number_slider_4)  # -> Grid, Weights

# ---- group: 1. Generate Elements / 3. Add elements / Primitive
brep = Brep(<brep referenced from the Rhino model>)

# ---- group: 1. Generate Elements / 3. Add elements
ptmorph3d = Morph3D(Grid1=ptcrvatts.Grid, Grid2=ptcrvatts_2.Grid, PatternObjects=brep, Shift_i=1, Shift_j=1, Pull=False)

# ---- group: 1. Generate Elements / 4. Define region / Region contour
crv_3 = Curve(<curve referenced from the Rhino model>)

# ---- group: 1. Generate Elements / 4. Define region
Z_2 = UnitZ(Factor=Slider(100, range=0..100))
extr = Extrude(Base=crv_3, Direction=Z_2)
area = Area(Geometry=ptmorph3d)  # -> Area, Centroid
cap = CapHoles(Brep=extr)
brepsinc = PointInBreps(Brep=cap, Point=area.Centroid, Strict=False)  # -> Inside, Index
cull = CullPattern(List=ptmorph3d, CullPattern=brepsinc.Inside)

# ---- group: 1. Generate Elements
divide = DivideCurve(Curve=crv_2, Count=Slider(100, range=0..100), Kinks=False)  # -> Points, Tangents, Parameters
brepsinc_2 = PointInBreps(Brep=cull, Point=flatten(divide.Points), Strict=False)  # -> Inside, Index
cull_i = CullIndex(List=cull, Indices=brepsinc_2.Index, Wrap=True)
preview = CustomPreview(Geometry=[cull_i, brep], Material=ColourSwatch(SwatchColor=RGB(84, 217, 128)))

# ---- group: 2b. Visualize Noise / Visualization space
standart_box = Brep(<brep referenced from the Rhino model>)
join = BrepJoin(Breps=standart_box)  # -> Breps, Closed
brep_2 = Brep(flatten(join.Breps))
lng = ListLength(List=brep_2)
repeat = RepeatData(Data="0", Length=lng)
wires = BrepWireframe(Brep=brep_2, Density=-1)
preview_2 = CustomPreview(Geometry=wires, Material=ColourSwatch(SwatchColor=RGB(255, 255, 255)))

# ----
smaller_box = Brep(<brep referenced from the Rhino model>)
bigger_box = Brep(<brep referenced from the Rhino model>)

# ---- group: 2. Simulate Noise / Initial noise level in decibels (dB)
number_slider_5 = Slider(100, range=0..100)

# ---- group: 2. Simulate Noise / Refresh model for simulation before each run
# No exploded shapes - all closed polysurfaces
button = Button(ExpressionNormal="True", ExpressionPressed="False")

# ---- group: 2. Simulate Noise / Listener
pt = Point(<point referenced from the Rhino model>)

# ---- group: 2. Simulate Noise / Noise source
pt_2 = Point(<point referenced from the Rhino model>)

# ----
# GG and GL not nessesary for simulation
poly_scene = PolygonScene(RhinoGeometry=button, GrasshopperGeometry=brep_2, GrasshopperLayers=repeat, VoxelGridDepth=7)

# ---- group: 3. Analyse Change / Outcome without elements
data = Data(81.09807918)

# ---- group: 2b. Visualize Noise / Noise direction
number_slider_6 = Slider(50, range=0..100)
X = UnitX(Factor=1)

# ---- group: 2b. Visualize Noise
pt_3 = Point(pt_2)

# ---- group: 2b. Visualize Noise / Noise direction (continued)
sph = Sphere(Base=pt_3, Radius=1)
sdivide = DivideSurface(Surface=sph, UCount=number_slider_6, VCount=number_slider_6)  # -> Points, Normals, Parameters
vec2pt = Vector2Pt(PointA=pt_3, PointB=sdivide.Points, Unitize=False)  # -> Vector, Length
vrot = Rotate(Vector=vec2pt.Vector, Axis=X, Angle=degrees(Slider(100, range=0..100)))
devec = DeconstructVector(Vector=vrot)  # -> XComponent, YComponent, ZComponent
larger = LargerThan(FirstNumber=devec.YComponent, SecondNumber=Slider(0, range=0..100))  # -> LargerThan, OrEqualTo
cull_2 = CullPattern(List=vec2pt.Vector, CullPattern=larger.LargerThan)
vdis = VectorDisplay(Anchor=pt_3, Vector=cull_2)

# ---- group: 2. Simulate Noise
dup = DuplicateData(Data=number_slider_5, Number=8, Order=True)
geosrc = GeodesicSource(Origin=pt_2, Power=dup, Delay=0)
number_slider_7 = Slider(1, range=0..1)
number_slider_8 = Slider(500, range=0..1000)
number_slider_9 = Slider(1000, range=0..1000)
statrec = StationaryReceiver(Origin=pt, Sources=geosrc, RoomModel=poly_scene, SampleFrequency=44100, CutOffTime=1000)
pach_ds = DirectSound(RoomModel=poly_scene, Source=geosrc, Receiver=statrec)
pach_is = ImageSource(RoomModel=poly_scene, Reflection_Order=number_slider_7, Source=geosrc, Receiver=statrec, EdgeDiffraction=Toggle(False))  # -> ImageSourceData, ReflectionTag, Reflections

# ---- group: 2. Simulate Noise / Enable to run simulation
pach_rt = RayTracing(
    RoomModel=poly_scene,
    NumberOfRays=number_slider_8,
    CutOffTime=number_slider_9,
    ImageSourceOrder=number_slider_7,
    Source=geosrc,
    Receiver=statrec,
    FrequencyScope=Domain(0, 7))  # disabled

# ---- group: 2. Simulate Noise (continued)
etc = EnergyTimeCurve(DirectSound=pach_ds, ImageSource=pach_is.ImageSourceData, RayTracing=pach_rt)

# ---- group: 2. Simulate Noise / Outcome noise level in decibels (dB)
spl_a = AWeightedSoundPressureLevel(EnergyTimeCurve=etc)

# ---- group: 3. Analyse Change / Outcome with elements
data_2 = Data(spl_a)

# ---- group: 3. Analyse Change
panel = Panel(data)
panel_2 = Panel(data_2)
subtraction = Subtraction(A=panel, B=panel_2)

# ---- group: 3. Analyse Change / Improvement in db
panel_3 = Panel(subtraction)

# ---- group: 2b. Visualize Noise (continued)
pachvisrays = VisualizePachydermRays(RoomModel=poly_scene, Source=geosrc, RayDirections=flatten(cull_2), NumberOfBounces=Slider(3, range=0..10))  # -> RayCurves, EndPoints, ArrivalTimeDelay

# ---- group: 2b. Visualize Noise / Timer
# Toggle to True for visualizing noise
trigger = Trigger(Interval=10, TimerInterval=10, Target=python)
toggle = BooleanToggle(False)

# ---- group: 2b. Visualize Noise (continued)
python = GhPythonScript(start=toggle)  # -> n; inputs start: Boolean
# ---------- python: Python ----------
__author__ = "Tom"
__version__ = "2022.01.20"

import rhinoscriptsyntax as rs

if start == False or 'counter' not in globals():
    counter = 0
else:
    counter += 1

n = counter
# ---------- end python ----------

# ---- group: 2b. Visualize Noise / Timer (continued)
division = Division(A=python, B=Slider(10000, range=0..10000))
addition = Addition(A=division, B=Slider(0, range=0..1))
panel_4 = Panel(addition)

# ---- group: 2b. Visualize Noise / Visualization
len = Length(Curve=pachvisrays.RayCurves)
sort = SortList(Keys=len)  # -> reverse(Keys), ValuesA
item = ListItem(List=sort.Keys, Index=0, Wrap=True)
multiplication = Multiplication(A=item, B=addition)
panel_5 = Panel(item)
eval = EvaluateLength(Curve=pachvisrays.RayCurves, Length=multiplication, Normalized=Toggle(False))  # -> Point, Tangent, Parameter
clean = CleanTree(RemoveNulls=True, RemoveInvalid=True, RemoveEmpty=False, Tree=eval.Point)
lng_2 = ListLength(List=flatten(cull_2))
lng_3 = ListLength(List=clean)
gradient = Gradient(
    LowerLimit=lng_2,
    UpperLimit=1,
    Parameter=lng_3,
    stops=[0: RGB(234, 38, 0), 0.25: RGB(234, 126, 0), 0.5: RGB(254, 244, 84), 0.75: RGB(173, 203, 249), 1: RGB(75, 107, 169)])
cloud = CloudDisplay(Points=eval.Point, Colours=gradient, Size=Slider(0.05, range=0..0.1), SpriteType=0)
