# Grasshopper definition geometry-generating-scripts.gh (Grasshopper 1.0.7)

# ----
# Genetically generated parameters
gene_pool = GenePool(Decimals=0, Maximum=10, Minimum=1, Value=[3, 5, 2])  # disabled

# ----
# Desired area
# Analysed Variants
number_slider = Slider(500, range=0..10000)  # disabled

# ----
# Genetically generated parameters
gene_pool_2 = GenePool(Decimals=0, Maximum=10, Minimum=1, Value=[1, 10, 1])

# ----
# Desired area
# Analysed Variants
number_slider_2 = Slider(500, range=0..1000)

# ----
# Desired Area: 500 m^2
# Height: 2 m
# T2-5-2-2
gene_pool_3 = GenePool(Decimals=0, Maximum=10, Minimum=1, Value=[5, 2, 2])
# Desired Area: 500 m^2
# Height: 2 m
# W2-4-2-7
gene_pool_4 = GenePool(Decimals=0, Maximum=10, Minimum=1, Value=[4, 2, 7])
area = Panel("504.0")
area_2 = Panel("499.99061")
# T2-9-2-2
gene_pool_5 = GenePool(Decimals=0, Maximum=10, Minimum=1, Value=[9, 2, 2])
# W2-7-1-6
gene_pool_6 = GenePool(Decimals=0, Maximum=10, Minimum=1, Value=[7, 1, 6])
area_4 = Panel("500.274696")
# T2-2-2-2
gene_pool_7 = GenePool(Decimals=0, Maximum=10, Minimum=1, Value=[2, 2, 2])
# W2-3-4-10
gene_pool_8 = GenePool(Decimals=0, Maximum=10, Minimum=1, Value=[3, 4, 10])
area_6 = Panel("501.178013")
# T2-9-6-9
gene_pool_9 = GenePool(Decimals=0, Maximum=10, Minimum=1, Value=[9, 6, 9])
area_7 = Panel("494.0")
panel = Panel("10")  # disabled
# W2-3-2-7
gene_pool_10 = GenePool(Decimals=0, Maximum=10, Minimum=1, Value=[3, 2, 7])
area_8 = Panel("501.642604")
# Desired Area: 500 m^2
# Height: 5 m
# T5-5-9-4
gene_pool_11 = GenePool(Decimals=0, Maximum=10, Minimum=1, Value=[5, 9, 5])
area_9 = Panel("490.0")

# ----
# Length
number_slider_3 = Slider(500, range=0..1000)  # disabled

# ----
# Desired Area: 500 m^2
# Height: 5 m
# W5-3-5-2
gene_pool_12 = GenePool(Decimals=0, Maximum=10, Minimum=1, Value=[3, 5, 2])
area_10 = Panel("501.784")

# ----
# Length
number_slider_4 = Slider(500, range=0..1000)

# ----
# T5-3-9-4
gene_pool_13 = GenePool(Decimals=0, Maximum=10, Minimum=1, Value=[3, 9, 4])
# W5-2-4-1
gene_pool_14 = GenePool(Decimals=0, Maximum=10, Minimum=1, Value=[2, 4, 1])
area_12 = Panel("498.103553")
# T5-1-9-5
gene_pool_15 = GenePool(Decimals=0, Maximum=10, Minimum=1, Value=[1, 9, 5])
area_13 = Panel("525.0")
# W5-4-3-1
gene_pool_16 = GenePool(Decimals=0, Maximum=10, Minimum=1, Value=[4, 3, 1])
area_14 = Panel("498.041289")
# Desired Area: 500 m^2
# Height: 10 m
# T10-6-10-1
gene_pool_17 = GenePool(Decimals=0, Maximum=10, Minimum=1, Value=[1, 9, 5])
area_15 = Panel("550.0")
# W5-3-8-7
gene_pool_18 = GenePool(Decimals=0, Maximum=10, Minimum=1, Value=[3, 8, 7])
area_16 = Panel("497.869245")
# T10-1-10-1
gene_pool_19 = GenePool(Decimals=0, Maximum=10, Minimum=1, Value=[1, 9, 5])
# Desired Area: 500 m^2
# Height: 10 m
# W10-1-10-6
gene_pool_20 = GenePool(Decimals=0, Maximum=10, Minimum=1, Value=[1, 10, 6])
area_18 = Panel("509.115279")

# ----
# Width
number_slider_5 = Slider(800, range=0..1000)

# ----
# Width
number_slider_6 = Slider(800, range=0..1000)  # disabled

# ----
# Parameters defining the shape
# Chose which parametrers should be defined and which should be calculated
# Type in the desired area and double click on galapagos to run the optimization
number = ListItem(List=gene_pool, Index=0, Wrap=True)  # disabled
width = ListItem(List=gene_pool, Index=2, Wrap=True)  # disabled
width_2 = ListItem(List=gene_pool, Index=1, Wrap=True)  # disabled
galapagos = Galapagos(fitness=number_2, gene=gene_pool)

# ----
# Connect a slider [1] or
# chose a generated value
panel_2 = Panel(number)  # disabled
panel_3 = Panel(width_2)  # disabled
number_slider_7 = Slider(5, range=0..10)  # disabled
panel_4 = Panel(width)  # disabled

multiplication = Multiplication(A=panel_2, B=panel)  # disabled

# ----
# Number of hills
# Height of hills
# Width of hills
# Height middle points
height_middle_poins = Number(panel_4)  # disabled
height_of_hills = Number(number_slider_7)  # disabled
width_of_hills = Number(panel_3)  # disabled
number_of_hills = Number(multiplication)  # disabled

# ----
# Geometry generation
# Base curve
number_slider_8 = Slider(0, range=0..100)  # disabled
construct_point = ConstructPoint(XCoordinate=number_slider_8, YCoordinate=0, ZCoordinate=0)  # disabled
construct_point_2 = ConstructPoint(XCoordinate=number_slider_3, YCoordinate=0, ZCoordinate=0)  # disabled
division = Division(A=1, B=number_of_hills)  # disabled
series = Series(Start=0, Step=division, Count=number_of_hills)  # disabled
line = Line(StartPoint=construct_point, EndPoint=construct_point_2)  # disabled
shatter = Shatter(Curve=line, Parameters=series)  # -> reparameterize(Segments); disabled
curve_middle = CurveMiddle(Curve=shatter)  # disabled

panel_5 = Panel("0 To 10")  # disabled
panel_6 = Panel("0 To 0.4")  # disabled
width_of_hills_2 = Number(width_of_hills)  # disabled
remap_numbers = RemapNumbers(Value=width_of_hills_2, Source=panel_5, Target=panel_6)  # -> Mapped, Clipped; disabled
subtraction = Subtraction(A=1, B=remap_numbers.Mapped)  # disabled
evaluate_curve = EvaluateCurve(Curve=graft(shatter), Parameter=[remap_numbers.Mapped, subtraction])  # -> Point, Tangent, Angle; disabled
list_item = ListItem(List=evaluate_curve.Point, Index=0, Wrap=True)  # disabled
list_item_2 = ListItem(List=evaluate_curve.Point, Index=1, Wrap=True)  # disabled

# ----
# Outer
# Left
# Right
point = Point(simplify(list_item_2))  # disabled
point_2 = Point(simplify(list_item))  # disabled

panel_7 = Panel("0 To 10")  # disabled
construct_domain = ConstructDomain(DomainStart=0, DomainEnd=height_of_hills)  # disabled
remap_numbers_2 = RemapNumbers(Value=height_middle_poins, Source=panel_7, Target=construct_domain)  # -> Mapped, Clipped; disabled
line_2 = Line(StartPoint=graft(curve_middle), EndPoint=[point_2, point])  # disabled
unit_z = UnitZ(Factor=remap_numbers_2.Mapped)  # disabled
curve_middle_2 = CurveMiddle(Curve=line_2)  # disabled
move = Move(Geometry=curve_middle_2, Motion=unit_z)  # -> Geometry, Transform; disabled
list_item_3 = ListItem(List=move.Geometry, Index=0, Wrap=True)  # disabled
list_item_4 = ListItem(List=move.Geometry, Index=1, Wrap=True)  # disabled

height_of_hills_2 = Number(height_of_hills)  # disabled
unit_z_2 = UnitZ(Factor=height_of_hills_2)  # disabled

# ----
# Top
move_2 = Move(Geometry=curve_middle, Motion=unit_z_2)  # -> simplify(graft(Geometry)), Transform; disabled

# ----
# Middle
# Left
# Right
point_3 = Point(simplify(list_item_3))  # disabled
point_4 = Point(simplify(list_item_4))  # disabled

# ----
# WAVES
interpolate_t = InterpolateT(Vertices=[point_2, point_3, move_2.Geometry, point_4, point], TangentStart=point_2, TangentEnd=point, KnotStyle=1)  # -> Curve, Length, Domain; disabled
line_3 = Line(StartPoint=point_2, EndPoint=point)  # disabled
join_curves = JoinCurves(Curves=[interpolate_t.Curve, line_3], Preserve=False)  # disabled
boundary_surfaces = BoundarySurfaces(Edges=join_curves)  # -> flatten(Surfaces); disabled

# ----
# Calculate total area
area_19 = Area(Geometry=boundary_surfaces)  # -> Area, Centroid; disabled
mass_addition = MassAddition(Input=area_19.Area)  # -> Result, PartialResults; disabled
total_area = Number(mass_addition.Result)  # disabled

total_area_2 = Number(total_area)  # disabled
subtraction_2 = Subtraction(A=total_area_2, B=number_slider)  # disabled
panel_8 = Panel(total_area_2)  # disabled
absolute = Absolute(Value=subtraction_2)  # disabled
number_2 = Number(absolute)  # disabled

# ----
# Extrude
unit_y = UnitY(Factor=number_slider_6)  # disabled
extrude = Extrude(Base=boundary_surfaces, Direction=unit_y)  # disabled
colour_swatch = ColourSwatch(SwatchColor=RGB(0, 255, 217))  # disabled
custom_preview = CustomPreview(Geometry=extrude, Material=colour_swatch)  # disabled

# ----
# Parameters defining the shape
# Chose which parametrers should be defined and which should be calculated
# Type in the desired area and double click on galapagos to run the optimization
number_3 = ListItem(List=gene_pool_2, Index=0, Wrap=True)
width_3 = ListItem(List=gene_pool_2, Index=2, Wrap=True)
width_4 = ListItem(List=gene_pool_2, Index=1, Wrap=True)
galapagos_2 = Galapagos(fitness=number_4, gene=gene_pool_2)

# ----
# Connect a slider [1] or
# chose a generated value
number_slider_9 = Slider(10, range=0..10)
panel_9 = Panel(number_3)
panel_10 = Panel(width_4)
panel_11 = Panel(width_3)

multiplication_2 = Multiplication(A=panel_9, B="10")

# ----
# Number of hills
# Height of hills
# Bottom width
# Upper width
height_middle_poins_2 = Number(panel_11)
height_of_hills_3 = Number(number_slider_9)
width_of_hills_3 = Number(panel_10)
number_of_hills_2 = Number(multiplication_2)

# ----
# Geometry generation
# Base curve
number_slider_10 = Slider(0, range=0..100)
construct_point_3 = ConstructPoint(XCoordinate=number_slider_10, YCoordinate=0, ZCoordinate=0)
construct_point_4 = ConstructPoint(XCoordinate=number_slider_4, YCoordinate=0, ZCoordinate=0)
division_2 = Division(A=1, B=number_of_hills_2)
series_2 = Series(Start=0, Step=division_2, Count=number_of_hills_2)
line_4 = Line(StartPoint=construct_point_3, EndPoint=construct_point_4)
shatter_2 = Shatter(Curve=line_4, Parameters=series_2)  # -> reparameterize(Segments)
curve_middle_3 = CurveMiddle(Curve=shatter_2)

width_of_hills_4 = Number(width_of_hills_3)
remap_numbers_3 = RemapNumbers(Value=width_of_hills_4, Source="0 To 10", Target="0 To 0.4")  # -> Mapped, Clipped
subtraction_3 = Subtraction(A=1, B=remap_numbers_3.Mapped)
evaluate_curve_2 = EvaluateCurve(Curve=graft(shatter_2), Parameter=[remap_numbers_3.Mapped, subtraction_3])  # -> Point, Tangent, Angle
list_item_5 = ListItem(List=evaluate_curve_2.Point, Index=0, Wrap=True)
list_item_6 = ListItem(List=evaluate_curve_2.Point, Index=1, Wrap=True)

height_of_hills_4 = Number(height_of_hills_3)

line_5 = Line(StartPoint=curve_middle_3, EndPoint=flatten(list_item_5))
list_item_7 = ListItem(List=line_5, Index=0, Wrap=True)
length = Length(Curve=list_item_7)
construct_domain_2 = ConstructDomain(DomainStart=0, DomainEnd=length)
unit_z_3 = UnitZ(Factor=height_of_hills_4)
remap_numbers_4 = RemapNumbers(Value=height_middle_poins_2, Source="0 To 10", Target=construct_domain_2)  # -> Mapped, Clipped
move_3 = Move(Geometry=curve_middle_3, Motion=unit_z_3)  # -> Geometry, Transform
negative = Negative(Value=remap_numbers_4.Mapped)
unit_x = UnitX(Factor=[negative, remap_numbers_4.Mapped])
move_4 = Move(Geometry=graft(move_3.Geometry), Motion=unit_x)  # -> Geometry, Transform
list_item_8 = ListItem(List=move_4.Geometry, Index=0, Wrap=True)
list_item_9 = ListItem(List=move_4.Geometry, Index=1, Wrap=True)

# ----
# Bottom
# Left
# Right
point_5 = Point(simplify(list_item_6))
point_6 = Point(simplify(list_item_5))

# ----
# Top
# Left
# Right
point_7 = Point(simplify(list_item_8))
point_8 = Point(simplify(list_item_9))

polyline = PolyLine(Vertices=[point_6, point_7, point_8, point_5], Closed=False)

# ----
# TRAPEZE
# With particular parameters will
# generate triangles and rectangles
line_6 = Line(StartPoint=point_6, EndPoint=point_5)
join_curves_2 = JoinCurves(Curves=[polyline, line_6], Preserve=False)
boundary_surfaces_2 = BoundarySurfaces(Edges=join_curves_2)  # -> flatten(Surfaces)

# ----
# Calculate total area
area_20 = Area(Geometry=boundary_surfaces_2)  # -> Area, Centroid
mass_addition_2 = MassAddition(Input=area_20.Area)  # -> Result, PartialResults
total_area_3 = Number(mass_addition_2.Result)

total_area_4 = Number(total_area_3)
subtraction_4 = Subtraction(A=total_area_4, B=number_slider_2)
panel_12 = Panel(total_area_4)
absolute_2 = Absolute(Value=subtraction_4)
number_4 = Number(absolute_2)

# ----
# Extrude
unit_y_2 = UnitY(Factor=number_slider_5)
extrude_2 = Extrude(Base=boundary_surfaces_2, Direction=unit_y_2)
custom_preview_2 = CustomPreview(Geometry=extrude_2, Material=ColourSwatch(SwatchColor=RGB(0, 255, 217)))
