# Grasshopper definition geometry_generation.gh (Grasshopper 1.0.7)
# plug-ins: PTComponentLibrary, Human

# ---- group: Height
# 4. Image
# This method greates surface based on the greyscale image, where white is the heighest point, and black lowest.
# 
# You can create your own image in photoshop or just fin an interesting one in the internet.
# Create the boundary for the surface according to the size of the image.
# Define the resolution of the image (the grid of points willl be created according to it)
# Select your image and assign the Domain X and Y.
# Play with the height coefficient to scale the surface height.
number_slider = Slider(6, range=0..10)  # disabled

# ---- group: Start Point
# Selected height are assigned to the points in the chess order.
point = Point(<point referenced from the Rhino model>)  # disabled

# ---- group: Grid Step Size X
step_x = Slider(20, range=0..100)  # disabled

# ---- group: Amount of cells X
amount_x = Slider(13, range=0..100)  # disabled

# ---- group: Grid Step Size Y
step_y = Slider(16, range=0..100)  # disabled

# ---- group: Amount of cells Y
number_slider_2 = Slider(10, range=0..100)  # disabled

# ---- group: Boundary
curve = Curve(<curve referenced from the Rhino model>)  # disabled

# ---- group: Resolution (Pixels)
x_px = Slider(188, range=0..10000)  # disabled
y_px = Slider(103, range=0..10000)  # disabled

# ---- group: Height coefficient
# 5. Skeleton
# This method creates a hill for each contour usign straight skeleton algorithm.
# 
# "Cutting curves" divide the region "Boundary" in subregions, that are defining each hill.
# Create new cutting curves in Rhino or edit the existing ones.
# Use "Landform Steepness" to scale the landfom in Z-direction.
max = Slider(5, range=0..100)  # disabled

# ---- group: Start Point
# 3.1 Random Heights Grid
# Heights are assign random.
# 
# You can define height diapasone.
# To create different variations change "Seed" parameter.
point_2 = Point(<point referenced from the Rhino model>)  # disabled

# ---- group: Profiles
curve_2 = Curve([<curve referenced from the Rhino model> x4])  # disabled

# ---- group: Grid Step Size X
step_x_2 = Slider(20, range=0..100)  # disabled

# ---- group: Amount of cells X
amount_x_2 = Slider(13, range=0..100)  # disabled

# ---- group: Loft Options
rebuild = Slider(0, range=0..100)  # disabled
refit = Slider(31.02, range=0..100)  # disabled
boolean_toggle = BooleanToggle(False)  # disabled
boolean_toggle_2 = BooleanToggle(False)  # disabled

# ---- group: Amount of cells Y
number_slider_3 = Slider(10, range=0..100)  # disabled

# ---- group: Start Point
# Creates a wave pattern with the defined height of the wave. The width of way is controlled by grid parameters.
point_3 = Point(<point referenced from the Rhino model>)  # disabled

# ---- group: Grid Step Size X
step_x_3 = Slider(20, range=0..100)  # disabled

# ---- group: Boundary
# 1. Populate Primitives
# This method works with the grid, which points are used to populate defined primitive.
# 
# You can change all components - especially the colored ones, as they are the main parameters of the park generator.
# If you want to have the constant height for all the elements, assign for the min and max value in "Height diapasone" the same values.
# To create the premitives with changing heights it is important to define the attractor (Curve or Point) and connect the desired element with the node "Defining heights"
# Feel free to add primitives and change the boundary, the paths, and regions in Rhino
# If you have advanced knowledge in Grasshopper, feel free to experiment with the script and add your own ideas for geometry creation.
curve_3 = Curve(<curve referenced from the Rhino model>)

# ---- group: Grid Step Size Y
number_slider_4 = Slider(20, range=0..100)

step_y_2 = Slider(16, range=0..100)  # disabled

# ---- group: Height diapasone
min = Slider(1, range=1..11)  # disabled
max_2 = Slider(7, range=1..51)  # disabled

# ---- group: Seed for random generator
# 3.2 Wave - One Direction
number_slider_5 = Slider(51, range=0..100)  # disabled

# ---- group: Amount of cells X
amount_x_3 = Slider(13, range=0..100)  # disabled

# ---- group: Grid Step Size Y
step_y_3 = Slider(16, range=0..100)  # disabled

# ---- group: Amount of cells Y
number_slider_6 = Slider(10, range=0..100)  # disabled

# ---- group: Heigth
# 3.3 Chess Order
number_slider_7 = Slider(5, range=0..40)  # disabled

# ---- group: Grid Step Size X
number_slider_8 = Slider(48, range=0..100)

# ---- group: Height diapasone
min_2 = Slider(0, range=0..1)
# 2. Loft
# This method might be used if you were designing a site through a series of site sections.
# 
# Try to move some points of profiles or assign absolutely new ones. The number of points in each profile should be the same to avoid errors. Select the curves in the order you want the surface to go through them. If you are creating your surface with Rhino you also need to be careful to select the proper end of the curve when you loft them. Basically, Rhino will number the control points of each curve with the first point being the point closest to the end that you select with the mouse.
# You can also change the position of the whole profile.
# Or experiment with the parameters of Loft Options to see different results.
# "Vertical distance between contour lines" controls, how the topography is displayed.
# If you have advanced knowledge in Grasshopper, feel free to experiment with the script and add your own ideas for geometry creation.
max_3 = Slider(0.1, range=0..0.1)

# ---- group: Cutting curves
curve_4 = Curve([<curve referenced from the Rhino model> x7])  # disabled

# ---- group: Boundary
curve_5 = Curve(<curve referenced from the Rhino model>)  # disabled

# ---- group: Loft Options / 0 = Normal, 1= Loose, 2 = Tight, 3 = Straight, 5 = Uniform
# 3. Point Grid Heights
# This method create the surface based on the grid of points. The main role is the Z position of points. It could be programmed random or with the spesific pattern (waves, chessorder, etc.). There is free suggested options, but you can come up with your own idea.
# 
# For all the options you can assign grid parameters (size and step), start point of the grid and heights.
# If you have advanced knowledge in Grasshopper, feel free to experiment with the script and add your own ideas for geometry creation.
type = Slider(1, range=0..5)  # disabled

# ----
deconstruct = Deconstruct(Point=point)  # -> XComponent, YComponent, ZComponent; disabled
boundary_surfaces = BoundarySurfaces(Edges=curve)  # disabled
deconstruct_2 = Deconstruct(Point=point_2)  # -> XComponent, YComponent, ZComponent; disabled
deconstruct_3 = Deconstruct(Point=point_3)  # -> XComponent, YComponent, ZComponent; disabled
boundary_surfaces_2 = BoundarySurfaces(Edges=curve_5)  # disabled
boundary = BoundarySurfaces(Edges=curve_3)
srf = Surface(boundary)
surface_split = SurfaceSplit(Surface=boundary_surfaces_2, Curves=curve_4)  # disabled
divide_surface = DivideSurface(Surface=boundary_surfaces, UCount=x_px, VCount=y_px)  # -> Points, Normals, Parameters; disabled
construct_domain = ConstructDomain(DomainStart=min, DomainEnd=max_2)  # disabled
construct_domain_2 = ConstructDomain(DomainStart=min_2, DomainEnd=max_3)
series = Series(Start=deconstruct_2.YComponent, Step=step_y_2, Count=number_slider_3)  # disabled
series_2 = Series(Start=deconstruct_2.XComponent, Step=step_x_2, Count=amount_x_2)  # disabled
series_3 = Series(Start=deconstruct_3.YComponent, Step=step_y_3, Count=number_slider_6)  # disabled
series_4 = Series(Start=deconstruct_3.XComponent, Step=step_x_3, Count=amount_x_3)  # disabled

# ---- group: Chess order
series_5 = Series(Start=0, Step=1, Count=number_slider_2)  # disabled
series_6 = Series(Start=0, Step=1, Count=amount_x)  # disabled
panel = Panel("2")  # disabled
addition = Addition(A=series_6, B=series_5, DataComparison="cross_reference")  # disabled
mod = Modulus(A=addition, B=panel)  # disabled

# ----
series_7 = Series(Start=deconstruct.YComponent, Step=step_y, Count=number_slider_2)  # disabled
series_8 = Series(Start=deconstruct.XComponent, Step=step_x, Count=amount_x)  # disabled
surface_domain_chord_distance = SurfaceDomainChordDistance(Surface=srf, UDistance=number_slider_8, VDistance=number_slider_4)
loft_options = LoftOptions(Closed=boolean_toggle, Adjust=boolean_toggle_2, Rebuild=rebuild, Refit=refit, Type=type)  # disabled
voronoi_cells_precision = Slider(10, range=0..1000)  # disabled

# ---- group: Attractor Curve
curve_6 = Curve(<curve referenced from the Rhino model>)

# ---- group: Attractor Point
point_4 = Point(Point(94, 435, 0))

# ----
deconstruct_brep = DeconstructBrep(Brep=surface_split)  # -> Faces, Edges, Vertices; disabled
construct_point = ConstructPoint(XCoordinate=series_2, YCoordinate=graft(series), ZCoordinate=0)  # -> flatten(Point); disabled
surface_closest_point = SurfaceClosestPoint(Point=divide_surface.Points, Surface=boundary_surfaces)  # -> Point, UVPoint, Distance; disabled

# ---- group: Vertical distance between contour lines
number_slider_9 = Slider(0.25, range=0..2)  # disabled

# ----
construct_point_2 = ConstructPoint(XCoordinate=series_4, YCoordinate=graft(series_3), ZCoordinate=0)  # disabled
join_curves = JoinCurves(Curves=deconstruct_brep.Edges, Preserve=False)  # disabled
list_length = ListLength(List=construct_point)  # disabled
panel_2 = Panel("2")  # disabled
construct_point_3 = ConstructPoint(XCoordinate=0, YCoordinate=0, ZCoordinate=0)  # disabled
unit_z = UnitZ(Factor=1)  # disabled
construct_point_4 = ConstructPoint(XCoordinate=series_8, YCoordinate=graft(series_7), ZCoordinate=0)  # disabled

curve_closest_point = CurveClosestPoint(Point=surface_domain_chord_distance, Curve=curve_6)  # -> Point, Parameter, Distance

distance = Distance(PointA=surface_domain_chord_distance, PointB=point_4)

# ---- group: Surface to bake
loft = Loft(Curves=curve_2, Options=loft_options)  # disabled

# ---- group: Image (Double click to set another image and X and Y Domian)
image_sampler = ImageSampler(
    surface_closest_point.UVPoint,
    FilePath="D:\Studium TUM\06 Precious Landscapes\00_Paper Extension\Workshop_Winterschool_03.2023\wavy-gradient-stripes-on-grayscale-wallpaper-abstract-moving-lines-pattern-background-free-vector.jpg",
    Filter="Value",
    Interpolate=False,
    Umax=188,
    Umin=1,
    Vmax=103,
    Vmin=1,
    Wrap=1)  # disabled

# ----
multiplication = Multiplication(A=number_slider_6, B=panel_2)  # disabled
division = Division(A=step_x_3, B=panel_2)  # disabled
division_2 = Division(A=step_x_3, B=panel_2)  # disabled
multiplication_2 = Multiplication(A=mod, B=number_slider)  # disabled
random = Random(Range=construct_domain, Number=list_length, Seed=number_slider_5)  # disabled

# ---- group: Draw and Trim Voroi Cells
divide = DivideCurve(Curve=join_curves, Count=voronoi_cells_precision, Kinks=False)  # -> Points, Tangents, Parameters; disabled
voronoi = Voronoi(Points=divide.Points, BruteForceOverride=False)  # -> simplify(Cells); disabled
trim = TrimWithRegion(Curve=voronoi, Region=join_curves)  # -> Inside, Outside; disabled

# ----
unit_z_2 = UnitZ(Factor=multiplication_2)  # disabled

# ---- group: Contour Lines of topography
# This method is based on this article:
# https://generativelandscapes.wordpress.com/2014/08/19/creating-an-editable-surface-with-points-example-4-3/
# 
# If you have some problems or errors feel free to read it.
contour = Contour(Shape=loft, Point=construct_point_3, Direction=unit_z, Distance=number_slider_9)  # disabled

# ---- group: Defining hights
remap_numbers = RemapNumbers(Value=curve_closest_point.Distance, Source=Domain(0, 1), Target=construct_domain_2)  # -> Mapped, Clipped

# ----
multiplication_3 = Multiplication(A=image_sampler, B=max)  # disabled
unit_z_3 = UnitZ(Factor=random)  # disabled
vector_xyz = VectorXYZ(XComponent=0, YComponent=division, ZComponent=number_slider_7)  # -> Vector, Length; disabled
unit_z_4 = UnitZ(Factor=multiplication_3)  # disabled
unit_z_5 = UnitZ(Factor=remap_numbers.Mapped)

# ---- group: Input Base Curves (Closed)
crv = Curve(graft(join_curves))  # disabled

# ----
move = Move(Geometry=flatten(construct_point_4), Motion=unit_z_2)  # -> Geometry, Transform; disabled
boolean_toggle_3 = BooleanToggle(True)  # disabled
move_2 = Move(Geometry=construct_point_2, Motion=vector_xyz.Vector)  # -> Geometry, Transform; disabled
move_3 = Move(Geometry=construct_point, Motion=unit_z_3)  # -> Geometry, Transform; disabled
boolean_toggle_4 = BooleanToggle(True)  # disabled
move_4 = Move(Geometry=divide_surface.Points, Motion=unit_z_4)  # -> simplify(flatten(Geometry)), Transform; disabled

# ---- group: Explode Cells and Seperate into Veins and Medial Axis
explode = Explode(Curve=trim.Inside, Recursive=True)  # -> Segments, Vertices; disabled
panel_3 = Panel("2")  # disabled
trim_2 = TrimTree(Tree=explode.Segments, Depth=panel_3)  # -> simplify(Tree); disabled
colom = CollisionOneMany(Collider=trim_2, Obstacles=crv)  # -> Collision, Index; disabled
dispatch = Dispatch(List=trim_2, DispatchPattern=colom.Collision)  # -> ListA, ListB; disabled

# ----
expression = Expression(x=x_px, Expression="x+1")  # disabled
# This method is based on this article:
# https://generativelandscapes.wordpress.com/2014/08/20/creating-surfaces-with-lofts-example-4-4/
# 
# If you have some problems or errors feel free to read it.
move_5 = Move(Geometry=surface_domain_chord_distance, Motion=unit_z_5)  # -> Geometry, Transform

# ---- group: Path
curve_7 = Curve(<curve referenced from the Rhino model>)

# ---- group: Magnitude
number_slider_10 = Slider(0, range=-3..3)

# ---- group: Vertical distance between contour lines
number_slider_11 = Slider(0.5, range=0..2)  # disabled

# ----
merge = Merge(Data1=construct_point_2, Data2=move_2.Geometry)  # disabled

# ---- group: Surface to bake
surface_from_points = SurfaceFromPoints(Points=move_3.Geometry, UCount=number_slider_3, Interpolate=boolean_toggle_4)  # disabled

# ----
construct_point_5 = ConstructPoint(XCoordinate=0, YCoordinate=0, ZCoordinate=0)  # disabled
unit_z_6 = UnitZ(Factor=1)  # disabled
boolean_toggle_5 = BooleanToggle(True)  # disabled

# ---- group: Surface to bakê
surface_from_points_2 = SurfaceFromPoints(Points=move_4.Geometry, UCount=expression, Interpolate=False)  # disabled

# ----
unit_z_7 = UnitZ(Factor=1)  # disabled
construct_point_6 = ConstructPoint(XCoordinate=0, YCoordinate=0, ZCoordinate=0)  # disabled
unit_z_8 = UnitZ(Factor=1)  # disabled

# ---- group: Vertical distance between contour lines
# This method is based on this article:
# https://generativelandscapes.wordpress.com/2014/09/12/surfaces-from-image-sampler-example-4-6/
# 
# If you have some problems or errors feel free to read it.
number_slider_12 = Slider(0.5, range=0..2)  # disabled

# This method is based on this article:
# https://generativelandscapes.wordpress.com/2015/07/14/landforms-created-through-topological-analysis-of-shapes-example-4-7/
# 
# If you have some problems or errors feel free to read it.
number_slider_13 = Slider(0.1, range=0..2)  # disabled

# ---- group: Surface to bake
surface_from_points_3 = SurfaceFromPoints(Points=flatten(move.Geometry), UCount=number_slider_2, Interpolate=boolean_toggle_3)  # disabled

# ----
construct_point_7 = ConstructPoint(XCoordinate=0, YCoordinate=0, ZCoordinate=0)  # disabled

# ---- group: Vertical distance between contour lines
number_slider_14 = Slider(0.5, range=0..2)  # disabled

# ----
construct_point_8 = ConstructPoint(XCoordinate=0, YCoordinate=0, ZCoordinate=0)  # disabled

# ---- group: Surface to bake
surface_from_points_4 = SurfaceFromPoints(Points=flatten(merge), UCount=multiplication, Interpolate=boolean_toggle_5)  # disabled

# ----
unit_z_9 = UnitZ(Factor=1)  # disabled

# ---- group: Contour Lines of topography
contour_2 = Contour(Shape=surface_from_points, Point=construct_point_5, Direction=unit_z_6, Distance=number_slider_11)  # disabled

# ---- group: Grid Down
ptcrvatts = CurveAttraction(Grid=surface_domain_chord_distance, CrvAtts=curve_7, Magnitude=number_slider_10)  # -> Grid, Weights

# ---- group: Grid Up
ptcrvatts_2 = CurveAttraction(Grid=move_5.Geometry, CrvAtts=curve_7, Magnitude=number_slider_10)  # -> Grid, Weights

# ---- group: Primitive
brep = Brep(<brep referenced from the Rhino model>)

# ---- group: Medial Axis (Landform Ridges)
geo = Geometry(dispatch.ListB)  # disabled

# ---- group: Veins (Perpendicular to Slope)
geo_2 = Geometry(dispatch.ListA)  # disabled

# ---- group: Contour Lines of topography
contour_3 = Contour(Shape=surface_from_points_2, Point=construct_point_6, Direction=unit_z_7, Distance=number_slider_13)  # disabled

contour_4 = Contour(Shape=surface_from_points_3, Point=construct_point_7, Direction=unit_z_8, Distance=number_slider_12)  # disabled

contour_5 = Contour(Shape=surface_from_points_4, Point=construct_point_8, Direction=unit_z_9, Distance=number_slider_14)  # disabled

# ---- group: Original Curves
geo_3 = Geometry(graft(join_curves))  # disabled

# ---- group: Elements to bake
ptmorph3d = Morph3D(Grid1=ptcrvatts.Grid, Grid2=ptcrvatts_2.Grid, PatternObjects=brep, Shift_i=1, Shift_j=1, Pull=False)

# ---- group: Veins
crv_2 = Curve(geo_2)  # disabled

crv_3 = Curve(geo)  # disabled

# ---- group: Original Curves
geo_4 = Geometry(graft(join_curves))  # disabled

# ----
end = EndPoints(Curve=crv_3)  # -> Start, End; disabled

# ---- group: Measure Distance of Endpoints to Edge Curve
end_2 = EndPoints(Curve=crv_2)  # -> Start, End; disabled
crv_cp = CurveClosestPoint(Point=end_2.Start, Curve=geo_3)  # -> Point, Parameter, Distance; disabled

# ---- group: Multiply Distance by Slope Factor / Landform Steepness
number_slider_15 = Slider(0.65, range=0..2)  # disabled

# ---- group: Landform Steepness
number_slider_16 = Slider(0.65, range=0..2)  # disabled

# ---- group: Measure distance of Start and Endpoints to Edge Curve
crv_cp_2 = CurveClosestPoint(Point=end.Start, Curve=geo_4)  # -> Point, Parameter, Distance; disabled
crv_cp_3 = CurveClosestPoint(Point=end.End, Curve=geo_4)  # -> Point, Parameter, Distance; disabled

# ---- group: Multiply Distance by Slope Factor
multiplication_4 = Multiplication(A=crv_cp.Distance, B=number_slider_15)  # disabled

# ---- group: Move Endpoints Vertically Based on Slope and Redraw Lines
Z = UnitZ(Factor=multiplication_4)  # disabled
move_6 = Move(Geometry=end_2.Start, Motion=Z)  # -> Geometry, Transform; disabled
ln = Line(StartPoint=move_6.Geometry, EndPoint=end_2.End)  # -> simplify(Line); disabled

# ---- group: Move Points Vertically Based on Landform Steepness
multiplication_5 = Multiplication(A=crv_cp_2.Distance, B=number_slider_16)  # disabled
multiplication_6 = Multiplication(A=crv_cp_3.Distance, B=number_slider_16)  # disabled
Z_2 = UnitZ(Factor=multiplication_5)  # disabled
Z_3 = UnitZ(Factor=multiplication_6)  # disabled
move_7 = Move(Geometry=end.Start, Motion=Z_2)  # -> Geometry, Transform; disabled
move_8 = Move(Geometry=end.End, Motion=Z_3)  # -> Geometry, Transform; disabled
ln_2 = Line(StartPoint=move_7.Geometry, EndPoint=move_8.Geometry)  # disabled

# ----
number_slider_17 = Slider(2, range=0..10)  # disabled

# ---- group: Seperate "Flat Veins" from Slopint Veins
curvepoint = PointOnCurve(ln, parameter=0.5)  # disabled
pdecon = Deconstruct(Point=curvepoint)  # -> XComponent, YComponent, ZComponent; disabled
panel_4 = Panel("0.1")  # disabled
larger = LargerThan(FirstNumber=pdecon.ZComponent, SecondNumber=panel_4)  # -> LargerThan, OrEqualTo; disabled
dispatch_2 = Dispatch(List=ln, DispatchPattern=larger.LargerThan)  # -> ListA, ListB; disabled

# ----
swatch = ColourSwatch(SwatchColor=RGB(0, 0, 0))  # disabled
preview = CustomPreview(Geometry=ln_2, Shader=swatch)  # disabled
previewlw = CustomPreviewLineweights(Geometry=ln_2, Shader=swatch, Thickness=number_slider_17, Absolute=False)  # disabled

# ---- group: Sloping Veins
geo_5 = Geometry(dispatch_2.ListA)  # disabled

geo_6 = Geometry(geo_5)  # disabled

# ----
end_3 = EndPoints(Curve=geo_6)  # -> Start, End; disabled
pdecon_2 = Deconstruct(Point=end_3.Start)  # -> XComponent, YComponent, ZComponent; disabled
pdecon_3 = Deconstruct(Point=end_3.End)  # -> XComponent, YComponent, ZComponent; disabled
graft = GraftTree(Tree=geo_6, IncludeEmptyLists=True, IncludeNullItems=True)  # disabled
pt = ConstructPoint(XCoordinate=pdecon_2.XComponent, YCoordinate=pdecon_2.YComponent, ZCoordinate=0)  # disabled
pt_2 = ConstructPoint(XCoordinate=pdecon_3.XComponent, YCoordinate=pdecon_3.YComponent, ZCoordinate=0)  # disabled
ln_3 = Line(StartPoint=pt, EndPoint=pt_2)  # -> graft(Line); disabled
loft_2 = Loft(Curves=[graft, ln_3], Options={Adjust=False, Closed=False, LoftEnds=0, LoftSimp=0, LoftType=0, Rebuild=10, Refit=0.01})  # disabled
swatch_2 = ColourSwatch(SwatchColor=RGBA(115, 73, 18, 65))  # disabled
preview_2 = CustomPreview(Geometry=loft_2, Shader=swatch_2)  # disabled

# ---- group: Use Endpoints of Veins to Define Mesh and then Cut Contours
end_4 = EndPoints(Curve=geo_5)  # -> Start, End; disabled
number_slider_18 = Slider(0.06, range=0..0.1)  # disabled
weave = Weave(Pattern=[0, 1], Stream0=end_4.Start, Stream1=end_4.End, NullGaps=False)  # disabled
contour_interval = Slider(1, range=1..100)  # disabled
number_slider_19 = Slider(0.5, range=0..1)  # disabled
pt_3 = ConstructPoint(XCoordinate=0, YCoordinate=0, ZCoordinate=number_slider_18)  # disabled
Z_4 = UnitZ(Factor=1)  # disabled
panel_5 = Panel("0")  # disabled
swatch_3 = ColourSwatch(SwatchColor=RGB(130, 130, 130))  # disabled

# ---- group: Use Endpoints of Veins to Define Mesh and then Cut Contours / Surface to bake
del = DelaunayMesh(Points=weave, Plane=PlaneXY(0, 0, 0))  # disabled

# ---- group: Use Endpoints of Veins to Define Mesh and then Cut Contours (continued)
contour_6 = Contour(Shape=del, Point=pt_3, Direction=Z_4, Distance=number_slider_19)  # disabled
trim_3 = TrimTree(Tree=contour_6, Depth=1)  # disabled
cull_i = CullIndex(List=trim_3, Indices=panel_5, Wrap=True)  # disabled
preview_3 = CustomPreview(Geometry=cull_i, Shader=swatch_3)  # disabled
