# Grasshopper definition AirportNoiseWebsiteSVGcolourful.gh (Grasshopper 1.0.7)

# ----
# Graph curve
curve = Curve([<curve referenced from the Rhino model> x7])
region_union = RegionUnion(Curves=curve)

# ----
# Scale to 1:1
# Numbers acquired graphically,
# then disconnected
division = Division(A=10, B=17)
scale = Scale(Geometry=region_union, Center=Point(0, 0, 0), Factor=division)  # -> Geometry, Transform

control_points = ControlPoints(Curve=scale.Geometry)  # -> Points, Weights, Knots

# ----
# Remove the lower corners
split_list = SplitList(List=control_points.Points, Index=1)  # -> ListA, ListB

# ----
# Move the graph to 0,0
construct_point = ConstructPoint(XCoordinate=0, YCoordinate=0, ZCoordinate=0)
vector_2pt = Vector2Pt(PointA=split_list.ListA, PointB=construct_point, Unitize=False)  # -> Vector, Length
move = Move(Geometry=control_points.Points, Motion=vector_2pt.Vector)  # -> Geometry, Transform

list_item = ListItem(List=move.Geometry, Index=Slider(514, range=0..1000), Wrap=True)

# ----
# Display points
number_slider = Slider(5, range=0..10)
dot_display = DotDisplay(Point=list_item, Colour=RGB(0, 0, 0), Size=number_slider)

# ----
# Remove the points with Y=0
number_slider_2 = Slider(0, range=0..100)
deconstruct = Deconstruct(Point=move.Geometry)  # -> XComponent, simplify(YComponent), ZComponent
equality = Equality(FirstNumber=deconstruct.YComponent, SecondNumber=number_slider_2)  # -> Equality, Inequality
dispatch = Dispatch(List=deconstruct.YComponent, DispatchPattern=equality.Equality)  # -> ListA, ListB

# ----
# Round th numbers to one digit after coma
panel = Panel("{0:0.0}")
format = Format(Format=panel, Culture=127, Data0=dispatch.ListB)
number = Number(format)

panel_2 = Panel(number)
